# Grasshopper definition HandtoEyeCalibration.gh (Grasshopper 1.0.8)
# plug-ins: Heteroptera, MeshEdit Components, PRC.GH, Weaverbird, froGH, NGon_RH8, Flexibility

pt = Point(<point referenced from the Rhino model>)
pdecon = Deconstruct(Point=pt)  # -> XComponent, YComponent, ZComponent
number_slider = Slider(-100, range=-100..0)
pt_2 = ConstructPoint(XCoordinate=pdecon.XComponent, YCoordinate="-2423", ZCoordinate=pdecon.ZComponent)
number_slider_2 = Slider(-7, range=-400..0)
brep = Brep(<brep referenced from the Rhino model>)
crv = Curve([<curve referenced from the Rhino model> x4])
subtraction = Subtraction(A=number_slider_2, B=Slider(422, range=0..1000))
ln = Line(StartPoint=pt_2, EndPoint=pt)
X = UnitX(Factor=Slider(382, range=0..1000))
yz = YZPlane(Origin=pt_2)
move = Move(Geometry=ln, Motion=X)  # -> Geometry, Transform
Z = UnitZ(Factor=subtraction)
divide = DivideCurve(Curve=crv, Count=Slider(10, range=0..10), Kinks=False)  # -> Points, Tangents, Parameters
flip = FlipMatrix(Data=divide.Points)
Z_2 = UnitZ(Factor=number_slider_2)
center = Center(Geometry=flip, forall=True)  # -> Center, Dimension
move_2 = Move(Geometry=ln, Motion=Z)  # -> Geometry, Transform
move_3 = Move(Geometry=move.Geometry, Motion=Z_2)  # -> Geometry, Transform
remove_dup_points = RemoveDuplicatrPoints(Points=divide.Points)
points = PointList(Points=remove_dup_points, Size=Slider(43, range=0..100))
flip_2 = FlipCurve(Curve=move_3.Geometry)  # -> Curve, Flag
mirror = Mirror(Geometry=flip_2.Curve, Plane=yz)  # -> Geometry, Transform
flip_3 = FlipMatrix(Data=center.Center)
entwine = Entwine(Branch00=flip_2.Curve, Branch01=ln, Branch02=mirror.Geometry, FlattenInputs=True)
number_slider_3 = Slider(4, range=0..10)
divide_2 = DivideCurve(Curve=move_2.Geometry, Count=number_slider_3, Kinks=False)  # -> Points, Tangents, Parameters
yz_2 = YZPlane(Origin=remove_dup_points)
xz = XZPlane(Origin=remove_dup_points)
divide_3 = DivideCurve(Curve=entwine, Count=number_slider_3, Kinks=False)  # -> Points, Tangents, Parameters
cp = ClosestPoint(Point=divide_3.Points, Cloud=divide_2.Points)  # -> ClosestPoint, CPIndex, Distance
geo = Geometry([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])
item = ListItem(List=divide_2.Points, Index=cp.CPIndex, Wrap=True)
mesh = Mesh(geo)
mesh_2 = Mesh(<mesh referenced from the Rhino model>)
pt_3 = ConstructPoint(XCoordinate=0, YCoordinate="24.08", ZCoordinate="128.26")
axis_6dof = AXISMotion6DOF(
    A01=Slider(-81, range=-180..180),
    A02=Slider(-27, range=-180..180),
    A03=Slider(15, range=-180..180),
    A04=Slider(0, range=0..180),
    A05=Slider(84, range=-90..180),
    A06=Slider(0, range=0..180),
    Speed=0)
weld = WeldMesh(Mesh=mesh, Radius=0.001, Align=False, Use_RTree=False)
vec2pt = Vector2Pt(PointA=divide_3.Points, PointB=item, Unitize=False)  # -> Vector, Length
xy = XYPlane(Origin=pt_3)
pl = PlaneNormal(Origin=divide_3.Points, ZAxis=vec2pt.Vector)  # -> flatten(Plane)
f_redmesh = ReduceMesh(Mesh=weld, ReductionRatio=Slider(0.9, range=0..1), Distortion=invert(False), Accuracy=5, NormalizeLength=False)
ptp_path = PTPPath(PTPMotions=axis_6dof, Interpolation="C_PTP")
abb_irb6700_150 = ABBIRB670015032()
frame = FrameViaPlane(Plane=xy, FrameID="6")
custom_tool = CustomTool(ToolFrame=frame, Mesh=f_redmesh)
number_slider_4 = Slider(-372, range=-1000..0)
Z_3 = UnitZ(Factor=number_slider_4)
Y = UnitY(Factor=number_slider_4)
move_4 = Move(Geometry=flip_3, Motion=Z_3)  # -> Geometry, Transform
vec2pt_2 = Vector2Pt(PointA=remove_dup_points, PointB=move_4.Geometry, Unitize=False)  # -> Vector, Length
amp = Amplitude(Vector=vec2pt_2.Vector, Amplitude=expr("-x", Slider(100, range=0..100)))
pl_2 = PlaneNormal(Origin=remove_dup_points, ZAxis=vec2pt_2.Vector)
prot = RotatePlane(Plane=pl_2, Angle=degrees(Slider(3, range=-180..180)))
item_2 = ListItem(List=prot, Index=0, Wrap=True)
item_3 = ListItem(List=amp, Index=0, Wrap=True)
move_5 = Move(Geometry=item_2, Motion=item_3)  # -> Geometry, Transform
ptp = PTPMotion(Plane=prot, Speed=nan, Posture="0")
ptp_2 = PTPMotion(Plane=move_5.Geometry, Speed=nan, Posture="0")
ptp_path_2 = PTPPath(PTPMotions=ptp, Interpolation="C_PTP")
ptp_path_3 = PTPPath(PTPMotions=ptp_2, Interpolation="C_PTP")
merge = Merge(Data1=ptp_path_2, Data2=ptp_path_3)
entwine_2 = Entwine(Branch00=ptp_path, Branch01=merge, Branch02=ptp_path, FlattenInputs=True)  # -> flatten(Result)
core_abb_rapid = CoreABBRAPID(
    SimulationSlider=Slider(0.468, range=0..1),
    ServerIPPort="https://127.0.0.1:5001",
    PRCCommands=entwine_2,
    Robot=abb_irb6700_150,
    ToolLibrary=custom_tool,
    massCustomization=False,
    serializedSettings="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",
    settingsOverrideVisible=False)  # -> SimulationValidity, SimulationResult, VisualizationReference
analysis = SimulationAnalysis(SimulationResult=core_abb_rapid.SimulationResult)  # -> AxisValues, CartesianPosition, Time, Colliding, OutOfReach, Singularity, InterpolationFactor, ID, Code, PRCID
visualizer = RobotVisualizer(VisualizationReference=core_abb_rapid.VisualizationReference)  # -> Meshes, Materials, AdditionalData
mesh_3 = Mesh(visualizer.Meshes)
path = FilePath("D:\")
py3 = Python3Script(pc_ip="192.168.0.7", code=analysis.Code, folder=path, folder_name="test", write=Button())  # -> out, modified_code
# ---------- py3: Python ----------
import os
import re

# --- Configuration ---
# Takes the pc_ip input directly from the Grasshopper node
my_pc_ip = pc_ip
my_pc_port = 5000
# ---------------------

def transform_rapid_code(input_text, pc_ip, pc_port):
    """Injects TCP socket communication into standard RAPID code with Error Handling."""
    
    variables_to_inject = f"""
    VAR socketdev client_socket;
    VAR string pc_ip := "{pc_ip}"; 
    VAR num pc_port := {pc_port};
    VAR bool socket_connected := FALSE;
"""

    custom_procedure = """
    PROC SendPoseAndCapture(robtarget p, speeddata spd)
        VAR robtarget p_curr;
        VAR string msg;
        VAR string ack;
        
        ! Move to position (always fine for calibration)
        MoveJ p, spd, fine, tool_0\\WObj:=wobjBase;
        
        WaitRob \\InPos;
        WaitTime 0.5;
        
        IF socket_connected THEN
            p_curr := CRobT(\\Tool:=tool_0 \\WObj:=wobjBase);
            
            msg := NumToStr(p_curr.trans.x, 3) + "," +
                   NumToStr(p_curr.trans.y, 3) + "," +
                   NumToStr(p_curr.trans.z, 3) + "," +
                   NumToStr(p_curr.rot.q1, 5) + "," +
                   NumToStr(p_curr.rot.q2, 5) + "," +
                   NumToStr(p_curr.rot.q3, 5) + "," +
                   NumToStr(p_curr.rot.q4, 5);
                   
            SocketSend client_socket \\Str:=msg;
            ! Wait for PC to respond, timeout after 5 seconds
            SocketReceive client_socket \\Str:=ack \\Time:=15; 
        ENDIF
        
    ERROR
        IF ERRNO = ERR_SOCK_TIMEOUT OR ERRNO = ERR_SOCK_CLOSED THEN
            TPWrite "TCP disconnected during capture. Skipping data send.";
            socket_connected := FALSE;
            TRYNEXT;
        ELSE
            TPWrite "Unknown TCP error.";
            socket_connected := FALSE;
            TRYNEXT;
        ENDIF
    ENDPROC
"""

    connection_code = """
        SocketCreate client_socket;
        ! Attempt to connect with a 3-second timeout
        SocketConnect client_socket, pc_ip, pc_port \\Time:=3;
        socket_connected := TRUE;
        TPWrite "Successfully connected to PC.";
"""

    close_code = """
        IF socket_connected THEN
            SocketSend client_socket \\Str:="DONE";
            SocketClose client_socket;
        ENDIF
        
    ERROR
        IF ERRNO = ERR_SOCK_TIMEOUT OR ERRNO = ERR_SOCK_CLOSED THEN
            TPWrite "Could not connect to PC socket. Running offline.";
            socket_connected := FALSE;
            TRYNEXT;
        ELSE
            TPWrite "Unknown error on connection.";
            socket_connected := FALSE;
            TRYNEXT;
        ENDIF
    """

    output_text = input_text

    # 1. Inject Variables before PROC main() - using lambda prevents backslash errors
    output_text = re.sub(r'(\s*PROC main\(\))', lambda m: variables_to_inject + m.group(1), output_text)
    
    # 2. Inject SocketConnect at the start of PROC main()
    output_text = re.sub(r'(PROC main\(\)\s*(?:ConfL \\Off;\s*)?(?:ConfJ \\On;\s*)?)', lambda m: m.group(1) + connection_code, output_text)
    
    # 3. Inject SocketClose and ERROR handling at the end of PROC main()
    output_text = re.sub(r'(\s*ENDPROC\s*ENDMODULE)', lambda m: close_code + m.group(1), output_text)

    # 4. Transform MoveJ to SendPoseAndCapture
    movej_pattern = re.compile(r'MoveJ\s+(\[\[.*?\],\s*\[.*?\],\s*\[.*?\],\s*\[.*?\]\])\s*,\s*([a-zA-Z0-9_]+)\s*,.*?;')
    output_text = movej_pattern.sub(r'SendPoseAndCapture \1, \2;', output_text)
    
    # 5. Append the custom procedure before ENDMODULE
    output_text = re.sub(r'(\s*ENDMODULE)', lambda m: custom_procedure + m.group(1), output_text)
    
    return output_text

# Handle both single string and list
if isinstance(code, list):
    code_text = "\n".join(code)
else:
    code_text = code
        
# Apply our transformation to add TCP functionality
if code_text:
    code_text = transform_rapid_code(code_text, my_pc_ip, my_pc_port)

# --- Execution ---
if write:
    full_path = os.path.join(folder, folder_name)
    
    if not os.path.exists(full_path):
        os.makedirs(full_path)    
    
    mod_path = os.path.join(full_path, "HandtoEye.modx")
    with open(mod_path, "w") as f:
        f.write(code_text)
    
modified_code = code_text
# ---------- end py3 ----------
mjoin = MeshJoin(Meshes=mesh_3)
alignvert = AlignVertices(Mesh=mjoin, Tolerance=0.01)  # -> Result, Count
cullvertices = MeshCullUnusedVertices(Mesh=alignvert.Result)
panel = Panel(py3.modified_code)
weldvertices = MeshWeldVertices(Mesh=cullvertices, Tolerance=0.01)  # -> RuntimeMessage, Mesh
wbcatmullclark = WeaverbirdsCatmullClarkSubdivision(MeshCurves=weldvertices.Mesh, Level=1, SmoothNakedEdges=1)
preview = CustomPreview(
    Geometry=wbcatmullclark,
    Material={diffuse=RGB(221, 160, 221), emission=RGB(66, 48, 66), shine=0.5, specular=RGB(255, 255, 255), transparency=0})
